# Grasshopper definition Curves r-w_text file.gh (Grasshopper 0.9.76)
# Copyright: Co-de-iT

filename = Panel("curves.txt")
# Curves R/W
# read-write curves
# code: Alessio Erioli
# v 10 July 2015
# > read
# to choose your own file
# right click on F parameter
# then 'Set One File Path'
# and locate your .txt file
file = ReadFile(File="F:\Users\alessio\Documents\Co-de-iT\@ code\GH code\Curves r-w_text.txt", PerLineParse=True)
crv = Curve([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])
preview = CustomPreview(Geometry=crv, Shader=ColourSwatch(SwatchColor=RGB(255, 255, 255)))
panel = Panel(file)
export = Button()
dirgen = CSharpScript(f=filename)  # -> Dt, Docs
# ---------- dirgen: C# ----------
    String eol = Environment.NewLine;
    Component.Message = "destination folder" + eol + "Dt - Desktop" + eol + "Docs - Documents";
    Dt = Environment.GetFolderPath(Environment.SpecialFolder.Desktop) + "\\" + f;
    Docs = Environment.GetFolderPath(Environment.SpecialFolder.MyDocuments) + "\\" + f;
# ---------- end dirgen ----------
divide = DivideCurve(Curve=crv, Count=Slider(38, range=2..100), Kinks=False)  # -> Points, Tangents, Parameters
split = TextSplit(Text=file, Separators="_")
pt = Point(split)
# > write
txtexp = CSharpScript(P=divide.Points, F=dirgen.Dt, sep="_", w=export)  # -> out, A; inputs P: tree of Point3d, F: String, sep: String, w: Boolean
# ---------- txtexp: C# ----------
    String eol = Environment.NewLine;
    Component.Message = "txt exporter" + eol + "v 1.0 by Co-de-iT";

    String s = "";
    List<String> curves = new List <String>();
    for (int k = 0; k < P.BranchCount; k++){
      s = "";
      for (int i = 0; i < P.Branches[k].Count; i++){
        s += P.Branches[k][i].X.ToString() + "," + P.Branches[k][i].Y.ToString() + "," +
          P.Branches[k][i].Z.ToString();
        if (i < P.Branches[k].Count - 1) s += sep;
      }
      curves.Add(s);
    }

    if (w) System.IO.File.WriteAllLines(F, curves);

    A = curves;
# ---------- end txtexp ----------
pline = PolyLine(Vertices=pt, Closed=False)
panel_2 = Panel(split)
panel_3 = Panel(txtexp.A)
preview_2 = CustomPreview(Geometry=pt, Shader=ColourSwatch(SwatchColor=RGB(0, 130, 115)))
preview_3 = CustomPreview(Geometry=pline, Shader=ColourSwatch(SwatchColor=RGB(43, 171, 156)))
